% Simulink data dictionary kspdemo.sldd

kspRxOut = Simulink.Bus()  % data received from KSP
  vessel: vesselRx  % received vessel data
  flight: flight  % received flight data

kspTxIn = Simulink.Bus()
  control: control  % control data
  autopilot: autopilot  % autopilot data

flight = Simulink.Bus()  % received flight data
  meanAltitude: double  % The altitude above sea level, in meters. Measured from the center of mass of the vessel.
  surfaceAltitude: double  % The altitude above the surface of the body or sea level, whichever is closer, in meters. Measured from the center of mass of the vessel.
  latitude: double  % The latitude of the vessel for the body being orbited, in degrees.
  longitude: double  % The longitude of the vessel for the body being orbited, in degrees.
  velocity: double[3]  % Vessel velocity (m/s) in reference frame vessel.orbit.body.reference_frame
  pitch: double  % The pitch of the vessel relative to the horizon, in degrees. A value between -90 and +90.
  heading: double  % The heading of the vessel (its angle relative to north), in degrees. A value between 0 and 360.
  gForce: double  % The current G force acting on the vessel in g.
  horizontalSpeed: double  % Vessel horizontal speed (m/s) in the surface frame.
  verticalSpeed: double  % Vessel vertical speed (m/s) in the surface frame.

mcout = Simulink.Bus()  % mode control signals
  mode: int16  % guidance system mode
  activateNextStage: boolean  % flag indicating stage activation

kspTxIn0 = struct(
  control=struct(sas=false, toggleSAS=false, throttle=0, activateNextStage=false, resetReferenceFrames=false),
  autopilot=struct(engage=false, targetPitch=0, targetHeading=0))

vesselRx = Simulink.Bus()  % received vessel data
  liquidFuelAmt: double  % Amount of liquid fuel remaining
  solidFuelAmt: double  % Amount of solid fuel remaining
  met: double  % mission elapsed time (s)
  apoapsisAltitude: double  % The apoapsis of the orbit, in meters, above the sea level of the body being orbited.
  periapsisAltitude: double  % The periapsis of the orbit, in meters, above the sea level of the body being orbited.
  timeToApoapsis: double  % Time to apoapsis (s).
  timeToPeriapsis: double  % Time to periapsis (s).
  eccentricity: double  % The eccentricity of the orbit.
  inclination: double  % The inclination of the orbit.
  orbitalSpeed: double  % Orbital speed (m/s).

autopilot = Simulink.Bus()  % autopilot bus
  engage: boolean  % engage autopilot
  targetPitch: double, Min=-90, Max=90  % target pitch angle (deg)
  targetHeading: double, Min=0, Max=360  % target heading angle (deg)
  commandPrograde: boolean  % Command SAS to drive vessel to prograde.
  commandRetrograde: boolean  % Command SAS to drive vessel to retrograde.

control = Simulink.Bus()  % control data
  sas: boolean  % SAS (stability assist system) state.
  throttle: double, Min=0, Max=1  % State of the throttle. A value between 0 and 1.
  activateNextStage: boolean  % activate next stage when true
  resetReferenceFrames: boolean  % Get current values for all ref. frames when true.