% Simulink data dictionary testdata.sldd

kspTxIn0 = struct(
  control=struct(sas=false, toggleSAS=false, throttle=0, activateNextStage=false),
  autopilot=struct(engage=false, targetPitch=0, targetHeading=0))

kspRxOut0 = struct(
  vessel=struct(liquidFuelAmt=0, solidFuelAmt=0, met=0),
  flight=struct(meanAltitude=0, surfaceAltitude=0, latitude=0, longitude=0, velocity=[0; 0; 0]))